# Grasshopper definition Little Island_Heatherwick Studio V2.gh (Grasshopper 1.0.8)
# plug-ins: Pufferfish, Human, LunchBox

number_slider = Slider(20, range=0..100)

# ---- group: Island Grid Size
number_slider_2 = Slider(50, range=0..100)
rectangle = Rectangle(Plane=PlaneXY(0, 0, 0), XSize=number_slider_2, YSize=number_slider_2, Radius=0)  # -> Rectangle, Length
pop2d = Populate2D(Region=rectangle.Rectangle, Count=Slider(100, range=0..200), Seed=Slider(20, range=0..100))  # -> flatten(Population)

# ---- group: Island Grid Control Curvature
pipeline = GeometryPipeline(
    GroupByLayer=False,
    GroupByType=False,
    IncludeHidden=True,
    IncludeLocked=True,
    LayerFilter="Grid of Points",
    NameFilter="*",
    SublayerFiltering=True,
    TypeFilter=1)
patch = Patch(Points=flatten(pipeline), Spans=20, Flexibility=1, Trim=True)
srf = Surface(patch)
srf_2 = Surface(srf)
project = ProjectCurve(Curve=rectangle.Rectangle, Brep=srf_2, Direction=Vector(0, 0, 1))
srfsplit = SurfaceSplit(Surface=srf_2, Curves=project)
dispatch = Dispatch(List=srfsplit, DispatchPattern=[True, False])  # -> ListA, ListB

# ----
sqgrid = Square(Plane=PlaneXY(0, 0, 0), Size=Slider(10, range=0..100), ExtentX=number_slider, ExtentY=number_slider)  # -> Cells, Points
area = Area(Geometry=sqgrid.Cells)  # -> Area, Centroid
pt = Point(pop2d)
pt_2 = Point(<point referenced from the Rhino model>)
pt_3 = Point(<point referenced from the Rhino model>)
pt_4 = Point(<point referenced from the Rhino model>)
srf_3 = Surface(dispatch.ListB)

# ---- group: Voronoi Base Creation
wires = BrepWireframe(Brep=srf_3, Density=-1)
join = JoinCurves(Curves=wires, Preserve=False)
project_2 = Project(Geometry=join, Plane=PlaneXY(0, 0, 0))  # -> flatten(Geometry), Transform
X = UnitX(Factor=Slider(0.5, range=0..2))
offset = OffsetCurve(Curve=project_2.Geometry, Distance=expr("-x", X), Corners=1)
voronoi = Voronoi(Points=pt, Boundary=offset, BruteForceOverride=False)

# ----
neg = Negative(Value=Slider(0, range=0..100))
panel = Panel("""0,255,255
5,250,255
10,245,255
15,240,255
20,235,255
25,230,255
30,225,255
35,220,255
40,215,255
45,210,255
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""")
preview = CustomPreview(Material=ColourSwatch(SwatchColor=RGB(234, 255, 255)))

# ---- group: Island Cluster Segmentation
dist = Distance(PointA=flatten(pt), PointB=pt_3)
dist_2 = Distance(PointA=flatten(pt), PointB=pt_4)
dist_3 = Distance(PointA=flatten(pt), PointB=pt_2)
extrz = Extremes(A=dist, B=dist_2, C=dist_3)  # -> Mininum, Maximum
number_slider_3 = Slider(3, range=0..10)
bnd = Bounds(Numbers=extrz.Mininum)
dom = ConstructDomain(DomainStart=0, DomainEnd=1)
remap = RemapNumbers(Value=extrz.Mininum, Source=bnd, Target=Domain(0, 1))  # -> Mapped, Clipped

# ----
div = DivideDomain(Domain=dom, Count=number_slider_3)  # -> graft(Segments)

# ---- group: Island Cluster Segmentation (continued)
inc = Includes(Value=remap.Mapped, Domain=div)  # -> Includes, Deviation
flip = FlipMatrix(Data=inc.Includes)
item = ListItem(List=flip, Index=0, Wrap=True)  # -> Item, Item1, Item2

# ----
md_slider = MDSlider(
    SliderMode=0,
    slider_value=Point(0.8826569348, 0.7479169892, 0.5),
    x_domain=Domain(0, 1),
    y_domain=Domain(0, 1),
    z_domain=Domain(0, 1))
cull = CullPattern(List=voronoi, CullPattern=flatten(item.Item1))
srf_4 = Surface(srf_3)
evalsrf = EvaluateSurface(Surface=reparameterize(srf_4), Point=md_slider)  # -> Point, Normal, UDirection, VDirection, Frame
Z = UnitZ(Factor=Slider(5, range=0..10))
move = Move(Geometry=evalsrf.Point, Motion=Z)  # -> Geometry, Transform
fillet = Fillet(Curve=cull, Radius=Slider(1, range=0..1))
patch_2 = Patch(Curves=srf_4, Points=move.Geometry, Spans=20, Flexibility=1, Trim=True)
project_3 = ProjectCurve(Curve=fillet, Brep=patch_2, Direction=Vector(0, 0, 1))
srfsplit_2 = SurfaceSplit(Surface=patch_2, Curves=project_3)
dispatch_2 = Dispatch(List=srfsplit_2, DispatchPattern=[True, False])  # -> ListA, ListB
srf_5 = Surface(simplify(dispatch_2.ListB))

# ---- group: Island Segmentation
cull_2 = CullPattern(List=voronoi, CullPattern=flatten(item.Item))
md_slider_2 = MDSlider(
    SliderMode=0,
    slider_value=Point(0.2169457412, 0.8073877474, 0.5),
    x_domain=Domain(0, 1),
    y_domain=Domain(0, 1),
    z_domain=Domain(0, 1))
srf_6 = Surface(srf_3)
evalsrf_2 = EvaluateSurface(Surface=reparameterize(srf_6), Point=md_slider_2)  # -> Point, Normal, UDirection, VDirection, Frame
number_slider_4 = Slider(1, range=0..1)
fillet_2 = Fillet(Curve=cull_2, Radius=Slider(1, range=0..1))
Z_2 = UnitZ(Factor=Slider(5, range=0..10))
move_2 = Move(Geometry=evalsrf_2.Point, Motion=Z_2)  # -> Geometry, Transform
patch_3 = Patch(Curves=srf_6, Points=move_2.Geometry, Spans=20, Flexibility=1, Trim=True)
project_4 = ProjectCurve(Curve=fillet_2, Brep=patch_3, Direction=Vector(0, 0, 1))
srfsplit_3 = SurfaceSplit(Surface=patch_3, Curves=project_4)
dispatch_3 = Dispatch(List=srfsplit_3, DispatchPattern=[True, False])  # -> ListA, ListB
srf_7 = Surface(simplify(dispatch_3.ListB))

# ----
md_slider_3 = MDSlider(
    SliderMode=0,
    slider_value=Point(0.5304878049, 0.5670731707, 0.5),
    x_domain=Domain(0, 1),
    y_domain=Domain(0, 1),
    z_domain=Domain(0, 1))
cull_3 = CullPattern(List=voronoi, CullPattern=flatten(item.Item2))
srf_8 = Surface(srf_3)
evalsrf_3 = EvaluateSurface(Surface=reparameterize(srf_8), Point=md_slider_3)  # -> Point, Normal, UDirection, VDirection, Frame
Z_3 = UnitZ(Factor=Slider(1, range=0..1))
fillet_3 = Fillet(Curve=cull_3, Radius=Slider(1, range=0..1))
move_3 = Move(Geometry=evalsrf_3.Point, Motion=Z_3)  # -> Geometry, Transform
patch_4 = Patch(Curves=srf_8, Points=move_3.Geometry, Spans=20, Flexibility=1, Trim=True)
project_5 = ProjectCurve(Curve=fillet_3, Brep=patch_4, Direction=Vector(0, 0, 1))
srfsplit_4 = SurfaceSplit(Surface=patch_4, Curves=project_5)
dispatch_4 = Dispatch(List=srfsplit_4, DispatchPattern=[True, False])  # -> ListA, ListB
srf_9 = Surface(simplify(dispatch_4.ListB))

crv = Curve(simplify(flatten(fillet)))
offset_2 = OffsetCurve(Curve=crv, Distance=expr("-x", Slider(0.5, range=0..3)), Corners=1)  # -> simplify(Curve)
fillet_4 = Fillet(Curve=offset_2, Radius=Slider(1, range=0..10))
neg_2 = Negative(Value=Slider(1.5, range=0..10))
project_6 = ProjectCurve(Curve=fillet_4, Brep=srf_5, Direction=Vector(0, 0, 1))  # -> simplify(Curve)
Z_4 = UnitZ(Factor=neg_2)
move_4 = Move(Geometry=project_6, Motion=Z_4)  # -> Geometry, Transform
srfsplit_5 = SurfaceSplit(Surface=srf_5, Curves=project_6)  # -> simplify(Fragments)
topoly = CurveToPolyline(Curve=move_4.Geometry, ToleranceDistance=0, ToleranceAngle=0)  # -> Polyline, Segments
dispatch_5 = Dispatch(List=srfsplit_5, DispatchPattern=[True, False])  # -> ListA, ListB
pcen = PolygonCenter(Polyline=topoly.Polyline)  # -> CenterV, CenterE, CenterA
scale = Scale(Geometry=move_4.Geometry, Center=pcen.CenterV, Factor=Slider(0.5, range=0..1))  # -> Geometry, Transform
srf_10 = Surface(dispatch_5.ListB)
loft = Loft(
    Curves=[project_6, scale.Geometry],
    Options={Adjust=False, Closed=False, LoftEnds=0, LoftSimp=0, LoftType=0, Rebuild=10, Refit=0.01})
patch_5 = Patch(Curves=scale.Geometry, Spans=20, Flexibility=1, Trim=True)
merge = Merge(Data1=srf_10, Data2=loft, Data3=patch_5)
join_2 = BrepJoin(Breps=merge)  # -> Breps, Closed

crv_2 = Curve(simplify(flatten(fillet_3)))
offset_3 = OffsetCurve(Curve=crv_2, Distance=expr("-x", Slider(0.5, range=0..3)), Corners=1)  # -> simplify(Curve)
fillet_5 = Fillet(Curve=offset_3, Radius=Slider(1, range=0..10))
neg_3 = Negative(Value=Slider(1.5, range=0..10))
project_7 = ProjectCurve(Curve=fillet_5, Brep=srf_9, Direction=Vector(0, 0, 1))  # -> simplify(Curve)
Z_5 = UnitZ(Factor=neg_3)
move_5 = Move(Geometry=project_7, Motion=Z_5)  # -> Geometry, Transform
srfsplit_6 = SurfaceSplit(Surface=srf_9, Curves=project_7)  # -> simplify(Fragments)
topoly_2 = CurveToPolyline(Curve=move_5.Geometry, ToleranceDistance=0, ToleranceAngle=0)  # -> Polyline, Segments
dispatch_6 = Dispatch(List=srfsplit_6, DispatchPattern=[True, False])  # -> ListA, ListB
pcen_2 = PolygonCenter(Polyline=topoly_2.Polyline)  # -> CenterV, CenterE, CenterA
scale_2 = Scale(Geometry=move_5.Geometry, Center=pcen_2.CenterV, Factor=Slider(0.5, range=0..1))  # -> Geometry, Transform
srf_11 = Surface(dispatch_6.ListB)
loft_2 = Loft(
    Curves=[project_7, scale_2.Geometry],
    Options={Adjust=False, Closed=False, LoftEnds=0, LoftSimp=0, LoftType=0, Rebuild=10, Refit=0.01})
patch_6 = Patch(Curves=scale_2.Geometry, Spans=20, Flexibility=1, Trim=True)
merge_2 = Merge(Data1=srf_11, Data2=loft_2, Data3=patch_6)
join_3 = BrepJoin(Breps=merge_2)  # -> Breps, Closed

merge_3 = Merge(Data1=srf_7, Data2=srf_5, Data3=srf_9)  # -> flatten(Result)

crv_3 = Curve(simplify(flatten(fillet_2)))
offset_4 = OffsetCurve(Curve=crv_3, Distance=expr("-x", Slider(0.5, range=0..3)), Corners=1)  # -> simplify(Curve)
fillet_6 = Fillet(Curve=offset_4, Radius=Slider(1, range=0..10))
neg_4 = Negative(Value=Slider(1.5, range=0..10))
project_8 = ProjectCurve(Curve=fillet_6, Brep=srf_7, Direction=Vector(0, 0, 1))  # -> simplify(Curve)
Z_6 = UnitZ(Factor=neg_4)
move_6 = Move(Geometry=project_8, Motion=Z_6)  # -> Geometry, Transform
srfsplit_7 = SurfaceSplit(Surface=srf_7, Curves=project_8)  # -> simplify(Fragments)
topoly_3 = CurveToPolyline(Curve=move_6.Geometry, ToleranceDistance=0, ToleranceAngle=0)  # -> Polyline, Segments
dispatch_7 = Dispatch(List=srfsplit_7, DispatchPattern=[True, False])  # -> ListA, ListB
pcen_3 = PolygonCenter(Polyline=topoly_3.Polyline)  # -> CenterV, CenterE, CenterA
scale_3 = Scale(Geometry=move_6.Geometry, Center=pcen_3.CenterV, Factor=Slider(0.5, range=0..1))  # -> Geometry, Transform
srf_12 = Surface(dispatch_7.ListB)
loft_3 = Loft(
    Curves=[project_8, scale_3.Geometry],
    Options={Adjust=False, Closed=False, LoftEnds=0, LoftSimp=0, LoftType=0, Rebuild=10, Refit=0.01})
patch_7 = Patch(Curves=scale_3.Geometry, Spans=20, Flexibility=1, Trim=True)
merge_4 = Merge(Data1=srf_12, Data2=loft_3, Data3=patch_7)
join_4 = BrepJoin(Breps=merge_4)  # -> Breps, Closed

srf_13 = Surface(simplify(graft(merge_3)))
crv_4 = Curve(simplify(graft(merge_3)))

# ---- group: Island Forms
crv_5 = Curve(crv_4)
neg_5 = Negative(Value=Slider(2, range=0..100))
Z_7 = UnitZ(Factor=neg_5)
move_7 = Move(Geometry=crv_5, Motion=Z_7)  # -> Geometry, Transform
topoly_4 = CurveToPolyline(Curve=move_7.Geometry, ToleranceDistance=0, ToleranceAngle=0)  # -> Polyline, Segments
pcen_4 = PolygonCenter(Polyline=topoly_4.Polyline)  # -> CenterV, CenterE, CenterA
scale_4 = Scale(Geometry=move_7.Geometry, Center=pcen_4.CenterV, Factor=Slider(0.5, range=0..1))  # -> Geometry, Transform
circle = CircleCNR(Center=pcen_4.CenterV, Normal=Vector(0, 0, 1), Radius=Slider(0.5, range=0..10))
neg_6 = Negative(Value=Slider(1, range=0..10))
neg_7 = Negative(Value=Slider(1, range=0..10))
Z_8 = UnitZ(Factor=neg_6)
Z_9 = UnitZ(Factor=neg_7)
move_8 = Move(Geometry=circle, Motion=Z_8)  # -> Geometry, Transform
move_9 = Move(Geometry=move_8.Geometry, Motion=Z_9)  # -> Geometry, Transform
pt_5 = ConstructPoint(XCoordinate=0, YCoordinate=0, ZCoordinate=neg)
movetoplane = MoveToPlane(Geometry=move_8.Geometry, Plane=pt_5, Above=True, Below=True)  # -> Geometry, Transform
merge_5 = Merge(Data1=crv_5, Data2=scale_4.Geometry)
relay = Relay([movetoplane.Geometry, move_9.Geometry])
loft_opt = LoftOptions(Closed=False, Adjust=Toggle(True), Rebuild=0, Refit=0, Type=Slider(1, range=0..5))
merge_6 = Merge(Data1=merge_5, Data2=move_8.Geometry, Data3=move_9.Geometry)
loft_4 = Loft(Curves=relay, Options={Adjust=False, Closed=False, LoftEnds=0, LoftSimp=0, LoftType=0, Rebuild=10, Refit=0.01})
loft_5 = Loft(Curves=merge_6, Options=loft_opt)
boundary = BoundarySurfaces(Edges=movetoplane.Geometry)
merge_7 = Merge(Data1=srf_13, Data2=loft_5, Data3=loft_4, Data4=boundary)
join_5 = BrepJoin(Breps=merge_7)  # -> Breps, Closed
volume = Volume(Geometry=join_5.Breps)  # -> Volume, Centroid
panel_2 = Panel(join_5.Breps)
panel_3 = Panel(volume.Volume)

# ----
clscrv = CloseCurve(Curve=crv_4, CloseType=0, Bulge=0.5, Tolerance=0)  # -> Closed, R

bbox = BoundingBox(Content=crv_4, Plane=PlaneXY(0, 0, 0))  # -> Box, Box_2
area_2 = Area(Geometry=bbox.Box)  # -> Area, Centroid
Z_10 = UnitZ(Factor=Slider(5, range=0..10))
move_10 = Move(Geometry=area_2.Centroid, Motion=expr("-x", Z_10))  # -> Geometry, Transform
cir = Circle(Plane=move_10.Geometry, Radius=Slider(0.5, range=0..1))

merge_8 = Merge(Data1=join_4.Breps, Data2=join_2.Breps, Data3=join_3.Breps)
sdiff = SolidDifference(BrepsA=flatten(join_5.Breps), BrepsB=flatten(merge_8))
volume_2 = Volume(Geometry=merge_8)  # -> flatten(Volume), Centroid
preview_2 = CustomPreview(Geometry=merge_8, Material=ColourSwatch(SwatchColor=RGBA(153, 139, 96, 113)))
volume_3 = Volume(Geometry=sdiff)  # -> Volume, Centroid
panel_4 = Panel(volume_3.Volume)
panel_5 = Panel(volume_2.Volume)

path = FilePath("/Users/hadiel-shayeb/Documents/GoogleDrive/0_Innovation Projects/Embodied Carbon Calculator/Embodied Carbon Materials List_ICE Database.csv")
file = ReadFile(File=path, PerLineParse=True)
csv = ReadCSV(CSVString=file, Delimiter=",", DataStruct=False)  # -> Headers, Values
panel_6 = Panel(file)
number_slider_5 = Slider(8, range=0..10)
number_slider_6 = Slider(4, range=0..10)
number_slider_7 = Slider(4, range=0..10)
number_slider_8 = Slider(6, range=0..10)
number_slider_9 = Slider(5, range=0..10)
item_2 = ListItem(List=csv.Headers, Index=number_slider_7, Wrap=True)
branch = TreeBranch(Tree=csv.Values, Path=number_slider_7, MaintainPaths=True)
item_3 = ListItem(List=csv.Headers, Index=number_slider_8, Wrap=True)
item_4 = ListItem(List=csv.Headers, Index=number_slider_5, Wrap=True)
item_5 = ListItem(List=csv.Headers, Index=number_slider_9, Wrap=True)
item_6 = ListItem(List=csv.Headers, Index=number_slider_6, Wrap=True)
panel_7 = Panel(item_4)
panel_8 = Panel(item_2)
panel_9 = Panel(branch)
panel_10 = Panel(item_5)
panel_11 = Panel(item_6)
panel_12 = Panel(item_3)

sort = SortList(Keys=panel_9, ValuesA=csv.Values)  # -> reverse(Keys), reverse(simplify(ValuesA))
panel_13 = Panel(sort.ValuesA)

branch_2 = TreeBranch(Tree=sort.ValuesA, Path=number_slider_8, MaintainPaths=True)
branch_3 = TreeBranch(Tree=sort.ValuesA, Path=number_slider_5, MaintainPaths=True)
branch_4 = TreeBranch(Tree=sort.ValuesA, Path=number_slider_9, MaintainPaths=True)
branch_5 = TreeBranch(Tree=sort.ValuesA, Path=number_slider_6, MaintainPaths=True)
panel_14 = Panel(branch_3)
panel_15 = Panel(branch_5)
panel_16 = Panel(branch_4)
panel_17 = Panel(branch_2)

# ---- group: Island Analytics
bbox_2 = BoundingBox(Content=clscrv.Closed, Plane=PlaneXY(0, 0, 0))  # -> Box, Box_2
area_3 = Area(Geometry=bbox_2.Box)  # -> Area, Centroid
pdecon = Deconstruct(Point=flatten(area_3.Centroid))  # -> XComponent, YComponent, ZComponent
project_9 = Project(Geometry=clscrv.Closed, Plane=PlaneXY(0, 0, 0))  # -> Geometry, Transform
hilonums = HighestLowestNumbers(Numbers=pdecon.ZComponent)  # -> Highest, Lowest
area_4 = Area(Geometry=project_9.Geometry)  # -> Area, Centroid
bbox_3 = BoundingBox(Content=crv_4, Plane=PlaneXY(0, 0, 0))  # -> Box, Box_2
project_10 = Project(Geometry=clscrv.Closed, Plane=PlaneXY(0, 0, 0))  # -> Geometry, Transform
ma = MassAddition(Input=flatten(area_4.Area))  # -> Result, PartialResults
area_5 = Area(Geometry=project_10.Geometry)  # -> Area, Centroid
roundd = RoundToDecimalPlace(NumberX=hilonums.Highest, DecimalPlace="2", RoundType=0)  # -> Rounded, Difference
area_6 = Area(Geometry=bbox_3.Box)  # -> Area, Centroid
Z_11 = UnitZ(Factor=Slider(0.5, range=0..1))
roundd_2 = RoundToDecimalPlace(NumberX=hilonums.Lowest, DecimalPlace="2", RoundType=0)  # -> Rounded, Difference
lng = ListLength(List=flatten(cir))
number_slider_10 = Slider(20, range=0..100)
number_slider_11 = Slider(20, range=0..100)
number_slider_12 = Slider(20, range=0..100)
number_slider_13 = Slider(20, range=0..100)
number_slider_14 = Slider(20, range=0..100)
roundd_3 = RoundToDecimalPlace(NumberX=ma.Result, DecimalPlace="2", RoundType=0)  # -> Rounded, Difference
number_slider_15 = Slider(20, range=0..100)
roundd_4 = RoundToDecimalPlace(NumberX=area_5.Area, DecimalPlace="2", RoundType=0)  # -> Rounded, Difference
move_11 = Move(Geometry=area_6.Centroid, Motion=Z_11)  # -> Geometry, Transform
concat = Concatenate(FragmentC="Minimum Height: ", FragmentA=roundd_2.Rounded, FragmentB="m")
concat_2 = Concatenate(FragmentC="Maximum Height: ", FragmentA=roundd.Rounded, FragmentB="m")
concat_3 = Concatenate(FragmentC="Number of Islands: ", FragmentA=lng)
concat_4 = Concatenate(FragmentC="Total Area of Islands: ", FragmentA=roundd_3.Rounded, FragmentB="m²")
concat_5 = Concatenate(FragmentC=roundd_4.Rounded, FragmentA="m²")
texttoscreen = RenderTextToScreen(Text=concat, Location="100,1550,0", Size=number_slider_15, Color=RGB(0, 0, 0), m_scWithvp=False)
texttoscreen_2 = RenderTextToScreen(Text=concat_2, Location="100,1520,0", Size=number_slider_15, Color=RGB(0, 0, 0), m_scWithvp=False)
texttoscreen_3 = RenderTextToScreen(Text=concat_3, Location="100,1460,0", Size=number_slider_15, Color=RGB(0, 0, 0), m_scWithvp=False)
texttoscreen_4 = RenderTextToScreen(Text=concat_4, Location="100,1490,0", Size=number_slider_15, Color=RGB(0, 0, 0), m_scWithvp=False)
tag = TextTag3D(Location=move_11.Geometry, Text=concat_5, Size=Slider(0.5, range=0..2), Justification=8)

# ----
pt_6 = Point(Point(44.69754228, 4.364037799, 0))
cps = ClosestPoints(Point=volume_2.Centroid, Cloud=pt_6, Count=3)  # -> ClosestPoint, CPIndex, simplify(flatten(Distance))
sort_2 = SortList(Keys=cps.Distance, ValuesA=sdiff)  # -> Keys, ValuesA
preview_3 = CustomPreview(Geometry=flatten(sort_2.ValuesA), Material=reverse(panel))
sort_3 = SortList(Keys=cps.Distance, ValuesA=flatten(merge_8))  # -> Keys, ValuesA
volume_4 = Volume(Geometry=sort_2.ValuesA)  # -> Volume, Centroid
area_7 = Area(Geometry=sort_3.ValuesA)  # -> Area, Centroid
Z_12 = UnitZ(Factor=Slider(1, range=0..10))
move_12 = Move(Geometry=area_7.Centroid, Motion=Z_12)  # -> Geometry, Transform
multiplication = Multiplication(A=volume_4.Volume, B=panel_14)
roundd_5 = RoundToDecimalPlace(NumberX=multiplication, DecimalPlace="2", RoundType=0)  # -> Rounded, Difference
lng_2 = ListLength(List=move_12.Geometry)

series = Series(Start=Slider(1, range=0..100), Step=Slider(1, range=0..100), Count=Slider(100, range=0..100))
series_2 = Series(Start=Slider(77, range=0..100), Step=Slider(17, range=0..100), Count=Slider(101, range=0..101))
concat_6 = Concatenate(
    FragmentG="ISLAND - ",
    FragmentF=series,
    FragmentH=" ",
    FragmentA=panel_15,
    FragmentC="// ",
    FragmentB=panel_16,
    FragmentD=": ",
    FragmentE=roundd_5.Rounded)
number_slider_16 = Slider(15, range=0..100)
expression = Expression(x=series_2, Expression="{2300, x, 300}")
split = SplitList(List=concat_6, Index=Slider(100, range=0..100))  # -> simplify(flatten(ListA)), simplify(flatten(ListB))
merge_9 = Merge(Data1="MATERIAL LIST AND EMBODIED CARBON VALUES (kgCO₂e/m³)", Data2=split.ListA)
texttoscreen_5 = RenderTextToScreen(Text=merge_9, Location=expression, Size=number_slider_16, Color=RGB(0, 0, 0), m_scWithvp=False)

rectangle_2 = Rectangle(Plane=PlaneXY(0, 0, 0), XSize=Slider(10, range=0..10), YSize=Slider(1.4, range=0..10), Radius=0)  # -> Rectangle, Length
boundary_2 = BoundarySurfaces(Edges=rectangle_2.Rectangle)
mesh_uv = MeshSurface(Surface=boundary_2, UCount=Slider(16, range=0..100), VCount=5, Overhang=True, Equalize=False)
demesh = DeconstructMesh(Mesh=mesh_uv)  # -> Vertices, Faces, Colours, Normals
panel_18 = Panel("""Lowest 
Embodied 
Carbon""")
panel_19 = Panel("""Highest 
Embodied 
Carbon""")
conmesh = ConstructMesh(Vertices=demesh.Vertices, Faces=demesh.Faces, Colours=reverse(panel))
meshtoscreen = RenderMeshToScreen(Mesh=conmesh, Location="100, 175, 100", ScaleFactor=Slider(41, range=0..100), Depth=0.95, Fixed=True, m_scWithvp=False)
texttoscreen_6 = RenderTextToScreen(Text=panel_18, Location="500, 200, 100", Size=number_slider_16, Color=RGB(0, 0, 0), m_scWithvp=False)
texttoscreen_7 = RenderTextToScreen(Text=panel_19, Location="100, 200, 100", Size=number_slider_16, Color=RGB(0, 0, 0), m_scWithvp=False)

expression_2 = Expression(x=roundd_5.Rounded, Expression="format(\"{0}\",x)")

# ---- group: Island Analytics (continued)
ma_2 = MassAddition(Input=expression_2)  # -> Result, PartialResults
roundd_6 = RoundToDecimalPlace(NumberX=ma_2.Result, DecimalPlace="2", RoundType=0)  # -> Rounded, Difference
ma_3 = MassAddition(Input=volume_4.Volume)  # -> Result, PartialResults
expression_3 = Expression(x=roundd_6.Rounded, Expression="format(\"{0}\",x)")
roundd_7 = RoundToDecimalPlace(NumberX=ma_3.Result, DecimalPlace="2", RoundType=0)  # -> Rounded, Difference
concat_7 = Concatenate(FragmentC="Total Embodied Carbon: ", FragmentA=expression_3, FragmentB="kgCO₂e/m³")
concat_8 = Concatenate(FragmentC="Total Structure Volume: ", FragmentA=roundd_7.Rounded, FragmentB="m³")
texttoscreen_8 = RenderTextToScreen(Text=concat_7, Location="100,1400,0", Size=number_slider_15, Color=RGB(0, 0, 0), m_scWithvp=False)
texttoscreen_9 = RenderTextToScreen(Text=concat_8, Location="100,1430,0", Size=number_slider_15, Color=RGB(0, 0, 0), m_scWithvp=False)

# ----
concat_9 = Concatenate(FragmentD="ISLAND - ", FragmentE=series, FragmentA=panel_16, FragmentC=": ", FragmentB=expression_2)
split_2 = SplitList(List=concat_9, Index=lng_2)  # -> simplify(flatten(ListA)), simplify(flatten(ListB))
tag_2 = TextTag3D(
    Location=move_12.Geometry,
    Text=split_2.ListA,
    Size=Slider(0.4, range=0..2),
    Colour=ColourSwatch(SwatchColor=RGB(255, 254, 255)),
    Justification=5)
