# Grasshopper definition Little Island_Heatherwick Studio.gh (Grasshopper 1.0.8)
# plug-ins: Pufferfish

number_slider = Slider(50, range=0..100)
rectangle = Rectangle(Plane=PlaneXY(0, 0, 0), XSize=number_slider, YSize=number_slider, Radius=0)  # -> Rectangle, Length
pop2d = Populate2D(Region=rectangle.Rectangle, Count=Slider(100, range=0..200), Seed=Slider(10, range=0..100))  # -> flatten(Population)

Z = UnitZ(Factor=Slider(5, range=0..100))
number_slider_2 = Slider(5, range=0..10)
move = Move(Geometry=rectangle.Rectangle, Motion=Z)  # -> Geometry, Transform
sdivide = DivideSurface(Surface=move.Geometry, UCount=number_slider_2, VCount=number_slider_2)  # -> flatten(Points), flatten(Normals), Parameters
lng = ListLength(List=sdivide.Points)
dom = ConstructDomain(DomainStart=Slider(5, range=0..10), DomainEnd=Slider(20, range=0..100))
random = Random(Range=dom, Number=lng, Seed=2)
amp = Amplitude(Vector=sdivide.Normals, Amplitude=random)
move_2 = Move(Geometry=sdivide.Points, Motion=amp)  # -> Geometry, Transform
addition = Addition(A=number_slider_2, B="1")
srfgrid = SurfaceFromPoints(Points=move_2.Geometry, UCount=addition, Interpolate=False)

pt = Point(pop2d)
srf = Surface(srfgrid)
pt_2 = Point(<point referenced from the Rhino model>)
pt_3 = Point(<point referenced from the Rhino model>)
pt_4 = Point(<point referenced from the Rhino model>)
wires = BrepWireframe(Brep=srf, Density=-1)
join = JoinCurves(Curves=wires, Preserve=False)
project = Project(Geometry=join, Plane=PlaneXY(0, 0, 0))  # -> flatten(Geometry), Transform
Z_2 = UnitZ(Factor=Slider(1, range=0..1))
offset = OffsetCurve(Curve=project.Geometry, Distance=Z_2, Corners=1)
voronoi = Voronoi(Points=pt, Boundary=offset, BruteForceOverride=False)
pt_5 = ConstructPoint(XCoordinate=0, YCoordinate=0, ZCoordinate=0)

dist = Distance(PointA=flatten(pt), PointB=pt_2)
dist_2 = Distance(PointA=flatten(pt), PointB=pt_3)
dist_3 = Distance(PointA=flatten(pt), PointB=pt_4)
extrz = Extremes(A=dist, B=dist_2, C=dist_3)  # -> Mininum, Maximum
bnd = Bounds(Numbers=extrz.Mininum)
dom_2 = ConstructDomain(DomainStart=0, DomainEnd=1)
remap = RemapNumbers(Value=extrz.Mininum, Source=bnd, Target=Domain(0, 1))  # -> Mapped, Clipped

div = DivideDomain(Domain=dom_2, Count=Slider(3, range=0..10))  # -> graft(Segments)

inc = Includes(Value=remap.Mapped, Domain=div)  # -> Includes, Deviation
flip = FlipMatrix(Data=inc.Includes)
item = ListItem(List=flip, Index=0, Wrap=True)  # -> Item, Item1, Item2

md_slider = MDSlider(
    SliderMode=0,
    slider_value=Point(0.1010920827, 0.9720218938, 0.5),
    x_domain=Domain(0, 1),
    y_domain=Domain(0, 1),
    z_domain=Domain(0, 1))
cull = CullPattern(List=voronoi, CullPattern=flatten(item.Item))
srf_2 = Surface(srf)
evalsrf = EvaluateSurface(Surface=reparameterize(srf_2), Point=md_slider)  # -> Point, Normal, UDirection, VDirection, Frame
Z_3 = UnitZ(Factor=Slider(0.3, range=0..1))
move_3 = Move(Geometry=evalsrf.Point, Motion=Z_3)  # -> Geometry, Transform
patch = Patch(Curves=srf_2, Points=move_3.Geometry, Spans=20, Flexibility=1, Trim=True)
project_2 = ProjectCurve(Curve=cull, Brep=patch, Direction=Vector(0, 0, 1))

md_slider_2 = MDSlider(
    SliderMode=0,
    slider_value=Point(0.8826569348, 0.7479169892, 0.5),
    x_domain=Domain(0, 1),
    y_domain=Domain(0, 1),
    z_domain=Domain(0, 1))
cull_2 = CullPattern(List=voronoi, CullPattern=flatten(item.Item1))
srf_3 = Surface(srf)
evalsrf_2 = EvaluateSurface(Surface=reparameterize(srf_3), Point=md_slider_2)  # -> Point, Normal, UDirection, VDirection, Frame
Z_4 = UnitZ(Factor=Slider(0.3, range=0..1))
move_4 = Move(Geometry=evalsrf_2.Point, Motion=Z_4)  # -> Geometry, Transform
patch_2 = Patch(Curves=srf_3, Points=move_4.Geometry, Spans=20, Flexibility=1, Trim=True)
project_3 = ProjectCurve(Curve=cull_2, Brep=patch_2, Direction=Vector(0, 0, 1))

md_slider_3 = MDSlider(
    SliderMode=0,
    slider_value=Point(0.5304878049, 0.5670731707, 0.5),
    x_domain=Domain(0, 1),
    y_domain=Domain(0, 1),
    z_domain=Domain(0, 1))
cull_3 = CullPattern(List=voronoi, CullPattern=flatten(item.Item2))
srf_4 = Surface(srf)
evalsrf_3 = EvaluateSurface(Surface=reparameterize(srf_4), Point=md_slider_3)  # -> Point, Normal, UDirection, VDirection, Frame
Z_5 = UnitZ(Factor=Slider(0.3, range=0..1))
move_5 = Move(Geometry=evalsrf_3.Point, Motion=Z_5)  # -> Geometry, Transform
patch_3 = Patch(Curves=srf_4, Points=move_5.Geometry, Spans=20, Flexibility=1, Trim=True)
project_4 = ProjectCurve(Curve=cull_3, Brep=patch_3, Direction=Vector(0, 0, 1))

merge = Merge(Data1=project_2, Data2=project_3, Data3=project_4)
crv = Curve(graft(merge))
trim = TrimTree(Tree=crv, Depth=1)
clscrv = CloseCurve(Curve=trim, CloseType=0, Bulge=0.5, Tolerance=0)  # -> graft(Closed), R
patch_4 = Patch(Curves=clscrv.Closed, Spans=20, Flexibility=1, Trim=True)
bbox = BoundingBox(Content=flatten([crv, pt_5]), Plane=PlaneXY(0, 0, 0), UnionBox=True)  # -> Box, Box_2

bbox_2 = BoundingBox(Content=crv, Plane=PlaneXY(0, 0, 0))  # -> Box, Box_2
area = Area(Geometry=bbox_2.Box)  # -> Area, Centroid
Z_6 = UnitZ(Factor=Slider(5, range=0..10))
move_6 = Move(Geometry=area.Centroid, Motion=expr("-x", Z_6))  # -> Geometry, Transform
cir = Circle(Plane=move_6.Geometry, Radius=Slider(0.5, range=0..1))  # -> graft(Circle)

explode = Explode(Curve=crv, Recursive=Toggle(False))  # -> Segments, Vertices
divide = DivideCurve(Curve=explode.Segments, Count="3", Kinks=False)  # -> Points, Tangents, Parameters
trim_2 = TrimTree(Tree=divide.Points, Depth=1)
crv_cp = CurveClosestPoint(Point=trim_2, Curve=cir)  # -> Point, Parameter, Distance
number_slider_3 = Slider(3, range=0..10)
ln = Line(StartPoint=trim_2, EndPoint=crv_cp.Point)
divide_2 = DivideCurve(Curve=ln, Count=number_slider_3, Kinks=False)  # -> Points, Tangents, Parameters

project_5 = ProjectPoint(Point=move_6.Geometry, Direction=Vector(0, 0, -1), Geometry=bbox.Box)  # -> Point, Index
project_6 = Project(Geometry=cir, Plane=project_5.Point)  # -> Geometry, Transform
rulesrf = RuledSurface(CurveA=cir, CurveB=project_6.Geometry)

range = Range(Domain=Domain(0, 1), Steps=number_slider_3)
graph = GraphMapper(range, x0=0, x1=1, y0=0, y1=1, container_name="Bezier", cpx=[0, 0.5144927502, 1, 1], cpy=[0, 0, 1, 0])
Z_7 = UnitZ(Factor=graph)

move_7 = Move(Geometry=divide_2.Points, Motion=Z_7)  # -> Geometry, Transform
intcrv = Interpolate(Vertices=move_7.Geometry, Degree=3, Periodic=False, KnotStyle=1)  # -> Curve, Length, Domain
trim_3 = TrimTree(Tree=intcrv.Curve, Depth=1)
shift = ShiftList(List=trim_3, Shift=1, Wrap=Toggle(True))

rulesrf_2 = RuledSurface(CurveA=shift, CurveB=trim_3)
join_2 = BrepJoin(Breps=[patch_4, rulesrf, rulesrf_2])  # -> Breps, Closed
preview = CustomPreview(Geometry=join_2.Breps, Material=ColourSwatch(SwatchColor=RGB(255, 254, 255)))
